# Grasshopper definition surface_area.gh (Grasshopper 1.0.7)

sph = Sphere(Base=PlaneXY(0, 0, 0), Radius=1)
vec = VectorXYZ(XComponent="25", YComponent="25", ZComponent="25")  # -> Vector, Length
move = Move(Geometry=sph, Motion=vec.Vector)  # -> Geometry, Transform
z_range_min = Number("0")
z_range_max = Number("50")
domain_max = Number("50")
domain_min = Number("0")
split_num = Number("50")
scale = Scale(Geometry=move.Geometry, Center=vec.Vector, Factor="20")  # -> Geometry, Transform
dom = ConstructDomain(DomainStart=domain_min, DomainEnd=domain_max)
srf = Surface(scale.Geometry)
range = Range(Domain=dom, Steps=split_num)  # -> graft(Range)
range_2 = Range(Domain=dom, Steps=split_num)
mesh = Mesh(srf)
vec_2 = VectorXYZ(XComponent=range, YComponent=range_2, ZComponent=0)  # -> flatten(Vector), Length
subtraction = Subtraction(A=domain_min, B=domain_max)
abs = Absolute(Value=subtraction)
division = Division(A=abs, B=split_num)
domain_width = Number(division)
vec_3 = Vector(vec_2.Vector)
xy = XYPlane(Origin=Point(0, 0, 0))
rectangle = Rectangle(Plane=xy, XSize=domain_width, YSize=domain_width, Radius=0)  # -> Rectangle, Length
boundary = BoundarySurfaces(Edges=rectangle.Rectangle)
move_2 = Move(Geometry=boundary, Motion=vec_3)  # -> Geometry, Transform
z_range_min_2 = Number(z_range_min)
z_range_max_2 = Number(z_range_max)
subtraction_2 = Subtraction(A=z_range_min_2, B=z_range_max_2)
abs_2 = Absolute(Value=subtraction_2)
z_range_width = Number(abs_2)
Z = UnitZ(Factor=abs_2)
extr = Extrude(Base=move_2.Geometry, Direction=Z)  # -> graft(Extrusion)
bvol = BoundaryVolume(Boundaries=extr)
sint = SolidIntersection(BrepsA=srf, BrepsB=bvol)
null = NullItem(Item=sint)  # -> NullFlags, InvalidFlags, Description
and = GateAnd(A=null.NullFlags, B=null.InvalidFlags)
dispatch = Dispatch(List=sint, DispatchPattern=and)  # -> ListA, ListB
brep = Brep(dispatch.ListB)
